# Dynamo graph Beam3_ CORRECTION DONE TO VERTICAL BEAMS.dyn (Dynamo 2.6.1.8786)
# packages: archi-lab.net 2020.23.12, Clockwork for Dynamo 0.9.x 0.90.8, Autodesk Analytical Modeling 2020 Dynamo 1.0.54, Synthesize toolkit 11.7.3

# group: Choose elements from revit
select_model_elements = DSModelElementsSelection()  # 20 picked in the model; graph input
isFraming = Dynamo4AM.Utilities.FilterElements.IsFraming(obj=select_model_elements)
filterByBoolMask = List.FilterByBoolMask(list=select_model_elements, mask=isFraming)

# group: Sorting beams on basis of material
code_block = CodeBlock { "Structural Material"; }
getParameterValueByName = Element.GetParameterValueByName(element=filterByBoolMask.in, parameterName=code_block)
name = Element.Name(element=getParameterValueByName)
code_block_2 = CodeBlock { "C"; }
boolean = BoolSelector(true)
contains = String.Contains(str=name, searchFor=code_block_2, ignoreCase=boolean)
filterByBoolMask_2 = List.FilterByBoolMask(list=filterByBoolMask.in, mask=contains)
getMaterials = Element.GetMaterials()  # unwired: element

# group: Create a project parameter "Is Cantilever" and sort the beams on basis on the value assigned to the parameter
code_block_3 = CodeBlock { "Is Cantilever"; }
getParameterValueByName_2 = Element.GetParameterValueByName(element=filterByBoolMask_2.in, parameterName=code_block_3)
code_block_4 = CodeBlock { "y"; }
eq = getParameterValueByName_2 == code_block_4
filterByBoolMask_3 = List.FilterByBoolMask(list=filterByBoolMask_2.in, mask=eq)
identity = Object.Identity(obj=filterByBoolMask_3.in)

# group: Filtering Beams Paraalel to x axis and y-axis
XAxis = Vector.XAxis()
getLocation = Element.GetLocation(element=filterByBoolMask_3.out)
direction = Line.Direction(line=getLocation)
isParallel = Vector.IsParallel(vector=XAxis, other=direction)
filterByBoolMask_4 = List.FilterByBoolMask(list=filterByBoolMask_3.out, mask=isParallel)
YAxis = Vector.YAxis()
getLocation_2 = Element.GetLocation(element=filterByBoolMask_4.out)
direction_2 = Line.Direction(line=getLocation_2)
isParallel_2 = Vector.IsParallel(vector=YAxis, other=direction_2)
filterByBoolMask_5 = List.FilterByBoolMask(list=filterByBoolMask_4.out, mask=isParallel_2)

flatten = List.Flatten(list=filterByBoolMask_5.in)

# group: Choose elements from revit
select_element_from_which_offset = DSModelElementsSelection()  # "Select element from which offset is calculated"; 1 picked in the model; graph input
isFraming_2 = Dynamo4AM.Utilities.FilterElements.IsFraming(obj=select_element_from_which_offset)
filterByBoolMask_6 = List.FilterByBoolMask(list=select_element_from_which_offset, mask=isFraming_2)

# group: offset values from user
offset_value_negative = DoubleSlider(7.75, range=0..50 step 0.01)  # graph input
offset_value_positive = DoubleSlider(7.87, range=0..50 step 0.01)  # graph input

# group: Vertical beams sorted
location = StructuralFraming.Location(structuralFraming=filterByBoolMask_6.in)
startPoint = Curve.StartPoint(curve=location)
X = Point.X(point=startPoint)
sub = X - offset_value_negative
add = X + offset_value_positive
count = List.Count(list=flatten)
code_block_5 = CodeBlock(Start=sub, end=add, count=count) { Start..end..#count; }
as_list_sortbykey = Custom[AS.[&] List.SortByKey](VARlist=flatten, VARkeys=code_block_5)  # package Synthesize toolkit; Sort a list (or lists) according to the order specified by the key list.
code_block_6 = CodeBlock { 3; }
flatten_2 = List.Flatten(list=as_list_sortbykey.VARsortedlist, amt=code_block_6)
location_2 = StructuralFraming.Location(structuralFraming=flatten)
startPoint_2 = Curve.StartPoint(curve=location_2)
Y = Point.Y(point=startPoint_2)
as_list_sortbykey_2 = Custom[AS.[&] List.SortByKey](VARlist=flatten_2, VARkeys=Y)
flatten_3 = List.Flatten(list=as_list_sortbykey_2.VARsortedlist, amt=code_block_6)

# group: Values from user
enter_level_number = StringInput("2")  # graph input
enter_suffix_for_vertical_beams = StringInput("VB")  # graph input
number_slider_gor_vertical_beams = DoubleSlider(24, range=0..500 step 1)  # graph input

code_block_7 = CodeBlock(l=enter_level_number, vb=enter_suffix_for_vertical_beams, m=number_slider_gor_vertical_beams, y=flatten_3) { l; vb; m; l+vb+(m..(m+(List.Count(y)-1))..1); }
code_block_8 = CodeBlock { "."; }
split = String.Split(str=code_block_7.out3, separator0=code_block_8)
code_block_9 = CodeBlock { 0; }
getItemAtIndex = List.GetItemAtIndex(list=split@L2, index=code_block_9)

# group: Setting mark values for vertical beams
code_block_10 = CodeBlock { "Mark"; }
setParameterByName = Element.SetParameterByName(element=flatten_3, parameterName=code_block_10, value=getItemAtIndex)

# group: Name for cantilever beam
enter_name_for_cantilever_beams = StringInput("")  # graph input

# group: Setting mark value as CANT for cantilever beam
code_block_11 = CodeBlock { "Mark"; }
setParameterByName_2 = Element.SetParameterByName(element=identity, parameterName=code_block_11, value=enter_name_for_cantilever_beams)

# group: Sort steel beams on basis on their size
identity_2 = Object.Identity(obj=filterByBoolMask_2.out)
code_block_12 = CodeBlock()
# ---------- code_block_12.designscript (6 lines) ----------
"
output = []
for x in IN[0]:
    output.append(float(filter(str.isdigit, x)))
OUT = output
";
# ----------------------------------------
type = archilab.Revit.Elements.Elements.Type(element=identity_2)
name_2 = Element.Name(element=type)
python_script_from_string = PythonStringNode(script=code_block_12, IN[0]=name_2)
string_from_object = FromObject(obj=python_script_from_string)
code_block_13 = CodeBlock { 0; 3; }
substring = String.Substring(str=string_from_object, startIndex=code_block_13.out0, length=code_block_13.out1)
sortByKey = List.SortByKey(list=identity_2, keys=substring)

# group: steel beam title
enter_suffix_for_the_steel_beam = StringInput("")  # graph input

# group: Grouping similar steel beams
identity_3 = Object.Identity(obj=sortByKey.sorted_list)
type_2 = archilab.Revit.Elements.Elements.Type(element=identity_3)
sortByKey_2 = List.SortByKey(list=type_2, keys=sortByKey.sorted_keys)
countOccurences = Custom[List.CountOccurences](seq=sortByKey_2.sorted_list)  # package Clockwork for Dynamo 0.9.x; Counts the number of occurences of each unique element in a given list
count_2 = List.Count(list=countOccurences.count)
code_block_14 = CodeBlock(st=enter_suffix_for_the_steel_beam, x=count_2) { st; st + (1..x..1); }
countOccurences_2 = Custom[List.CountOccurences](seq=sortByKey_2.sorted_list)

# group: Setting mark values for steel beams
code_block_15 = CodeBlock { "Mark"; }
cycle = List.Cycle(list=code_block_14.out1@L1, amount=countOccurences_2.count@L1)
flatten_4 = List.Flatten(list=cycle)
setParameterByName_3 = Element.SetParameterByName(element=sortByKey.sorted_list, parameterName=code_block_15, value=flatten_4)
