# Dynamo graph Extract all Modelled Family and its Type to CSV.dyn (Dynamo 2.16.1.2727)
# packages: archi-lab.net 2023.213.1722, Clockwork for Dynamo 2.x 2.6.0

file_path = Filename("..\delete me\check_for_dynamo3.csv")  # graph input
select_model_elements = DSModelElementsSelection()  # 703 picked in the model; graph input
getCategory = archilab.Revit.Elements.Elements.GetCategory(element=select_model_elements, lacing=Longest)
groupByKey = List.GroupByKey(list=select_model_elements, keys=getCategory)
identity = Object.Identity(object=groupByKey.groups)
elementType = Custom[Element.ElementType+](element=identity@L2)  # package Clockwork for Dynamo 2.x; Gets the family type of a given element (if applicable). Unlike the OOTB node, it also works for elements in linked models.
isNull = Object.IsNull(object=elementType)
filterByBoolMask = List.FilterByBoolMask(list=elementType, mask=isNull)
isEmpty = List.IsEmpty(list=filterByBoolMask.out@L2)
filterByBoolMask_2 = List.FilterByBoolMask(list=filterByBoolMask.out, mask=isEmpty)
uniqueItems = List.UniqueItems(list=filterByBoolMask_2.out@L2)
getCategory_2 = archilab.Revit.Elements.Elements.GetCategory(element=uniqueItems)
uniqueItems_2 = List.UniqueItems(list=getCategory_2@L2)
flatten = List.Flatten(list=uniqueItems_2)
string_from_object = FromObject(object=flatten)
code_block = CodeBlock { " - Family"; ""; " - Family Type"; }
string_from_list = Custom[String From List](list=string_from_object, suffix=code_block.out0, seperator=code_block.out1)  # package archi-lab.net; This node will take an input of a list or nested list and then join each element in a list with a given seperator while adding a suffix.
count = List.Count(list=uniqueItems@L2)
ofRepeatedItem = List.OfRepeatedItem(item=string_from_list@L1, amount=count@L1)
uniqueItems_3 = List.UniqueItems(list=ofRepeatedItem@L2)
identity_2 = Object.Identity(object=uniqueItems)
familyName = Custom[FamilyType.FamilyName](familyType=identity_2@L2)  # package Clockwork for Dynamo 2.x; Returns the *family* name of a given family *type*. ATTENTION: This node will be deprecated in 2023. Please switch to the OOTB node ElementType.FamilyName.
addItemToFront = List.AddItemToFront(item=uniqueItems_3@L1, list=familyName@L2, lacing=Longest)
string_from_list_2 = Custom[String From List](list=string_from_object, suffix=code_block.out2, seperator=code_block.out1)
ofRepeatedItem_2 = List.OfRepeatedItem(item=string_from_list_2@L1, amount=count@L1)
uniqueItems_4 = List.UniqueItems(list=ofRepeatedItem_2@L2)
name = FloorType.Name(floorType=identity_2)
addItemToFront_2 = List.AddItemToFront(item=uniqueItems_4@L1, list=name@L2, lacing=Longest)
list_create = List.Create(item0=addItemToFront, item1=addItemToFront_2)
transpose = List.Transpose(lists=list_create@L3, lacing=Longest)
code_block_2 = CodeBlock { 1; }
flatten_2 = List.Flatten(list=transpose, amount=code_block_2)
exportCSV = Custom[Data.ExportCSV+](path=file_path, data=flatten_2)  # package Clockwork for Dynamo 2.x; Writes data to a CSV file with a custom delimiter. Data inputs needs to contain strings only!
